# Grasshopper definition UR-Robotfeedback01 [Feb-11 '21, 2304].gh (Grasshopper 1.0.7)
# plug-ins: Robots

robot_ip_address = Panel("192.168.178.120")

# ---- group: Get RobotData Once
robootip_txt = Text(robot_ip_address)
c_script = CSharpScript(getData=Button(), IP=robootip_txt, Reference="C:\Users\HP\AppData\Roaming\Grasshopper\Libraries\Robots.dll")  # -> out, RobotData; inputs getData: Boolean, IP: String
# ---------- c_script: C# usings ----------
using Grasshopper.Kernel.Special;
using Robots;
# ---------- c_script: C# ----------
    if(DataAsTree == null)
    {
      DataAsTree = new DataTree<double>();
    }
    if (getData == true)
    {
      DataAsTree.ClearData();
      List<double> datapack = new List<double>();
      var RobotConnection = new URRealTime(IP);
      var Feedbackdata = RobotConnection.FeedbackData;
      RobotConnection.UpdateFeedback();
      Feedbackdata = RobotConnection.FeedbackData;
      for (var j = 0; j < Feedbackdata.Count; j++)
      {
        datapack = new List<double>();
        for (var k = 0; k < Feedbackdata[j].Value.Length; k++)
        {
          datapack.Add(Feedbackdata[j].Value[k]);
        }
        GH_Path path = new GH_Path(j);
        DataAsTree.AddRange(datapack, path);
      }

    }
    RobotData = DataAsTree;
# ---------- c_script: C# additional code ----------
  DataTree<double> DataAsTree;

  /// <summary>
  /// This method will be called once every solution, before any calls to RunScript.
  /// </summary>
  public override void BeforeRunScript()
  { }
  /// <summary>
  /// This method will be called once every solution, after any calls to RunScript.
  /// </summary>
  public override void AfterRunScript()
  { }
# ---------- end c_script ----------
robot_feedback_data = Data(c_script.RobotData)

# ---- group: Get RobotData Continuously
autoupdate = BooleanToggle(False)
robootip_txt_2 = Text(robot_ip_address)
c_script_2 = CSharpScript(AutoUpdate=autoupdate, IP=robootip_txt_2, Reference="C:\Users\HP\AppData\Roaming\Grasshopper\Libraries\Robots.dll")  # -> out, RobotData; inputs AutoUpdate: Boolean, IP: String
# ---------- c_script_2: C# ----------
    datapack = new List<double>();

    if (RobotConnection == null)
    {
      RobotAddress = IP;
      RobotConnection = new URRealTime(RobotAddress);
      Feedbackdata = RobotConnection.FeedbackData;
    }

    if (DataAsTree == null)
    {
      DataAsTree = new DataTree<double>();
    }

    if (task == null || task.IsCompleted)
    {
      task = System.Threading.Tasks.Task.Run(() => Animation());
    }

    RobotData = DataAsTree;
    if (AutoUpdate == true)
    {
      Component.ExpireSolution(true);
    }
# ---------- c_script_2: C# additional code ----------
  System.Threading.Tasks.Task task = null;
  URRealTime RobotConnection;
  String RobotAddress;
  DataTree<double> DataAsTree;
  List<double> datapack;
  List<FeedbackType> Feedbackdata;
  GH_Path path;

  void Animation()
  {
    RobotConnection.UpdateFeedback();
    Feedbackdata = RobotConnection.FeedbackData;

    for (var j = 0; j < Feedbackdata.Count; j++)
    {
      datapack = new List<double>();
      for (var k = 0; k < Feedbackdata[j].Value.Length; k++)
      {
        datapack.Add(Feedbackdata[j].Value[k]);
      }
      path = new GH_Path(j);
      DataAsTree.RemovePath(j);
      DataAsTree.AddRange(datapack, path);
    }
  }


  /// <summary>
  /// This method will be called once every solution, before any calls to RunScript.
  /// </summary>
  public override void BeforeRunScript()
  { }
  /// <summary>
  /// This method will be called once every solution, after any calls to RunScript.
  /// </summary>
  public override void AfterRunScript()
  { }
# ---------- end c_script_2 ----------
robot_feedback_data_2 = Data(c_script_2.RobotData)

# ---- group: Load Robot System
list = ValueList({"Bartlett-IRB120", "Bartlett-IRB1600", "Bartlett-KR6", "Bartlett-KR60-A", "Bartlett-KR60-B", "Bartlett-KR500", "Bartlett-KR60 on track", "Bartlett-UR10", "Bartlett-KR60", "Bartlett-TX200", "Bartlett-TX200L", "Bartlett-RX160", "Bartlett-RX160L", "ETH-Gantry", "KULeuven-IRB120", "KULeuven-UR5", "KULeuven-UR10", "RMIT UR10"}, selected="KULeuven-UR5")
load_robot_system = LoadRobotSystem(Name=list, Base=PlaneXY(0, 0, 0))

# ---- group: Get Current TCP Position
robot_feedback_data_3 = Data(robot_feedback_data_2)

# Comment: Get the 13th path, which holds the TCP coordinates in cartesian space. See here for what the other branches hold:
# https://www.universal-robots.com/articles/ur/real-time-data-exchange-rtde-guide/
panel = Panel("13")
construct_path = ConstructPath(Indices=panel)
tree_branch = TreeBranch(Tree=robot_feedback_data_3, Path=construct_path, MaintainPaths=True)

# Comment: UR-Robots give their positional values in Meters instead of mm. The positional values have to therefore be multiplied by 1000, the rotational values stay the same.
panel_2 = Panel("1")
merge = Merge(Data1="1000", Data2="1000", Data3="1000", Data4=panel_2, Data5=panel_2, Data6=panel_2)
multiplication = Multiplication(A=tree_branch, B=merge)

tcp_cartesiancoords_num = Number(multiplication)

# ----
robotsystem_parameter = RobotSystemParameter(load_robot_system)
get_plane = GetPlane(Numbers=tcp_cartesiancoords_num, RobotSystem=robotsystem_parameter)
plane = Plane(get_plane)

# ---- group: Display TCP
plane_display_size = Slider(79, range=0..100)
plane_2 = Plane(plane)
display_plane_origin = BooleanToggle(True)
display_plane_directions = DisplayPlaneDirections(origin_display=display_plane_origin, plane=plane_2, size=plane_display_size)

# ---- group: Get Current Joint Angles
robot_feedback_data_4 = Data(robot_feedback_data_2)

# Comment: Get the 7th path, which holds the current Joint angles.
# See here for what the other branches hold:
# https://www.universal-robots.com/articles/ur/real-time-data-exchange-rtde-guide/
panel_3 = Panel("7")
construct_path_2 = ConstructPath(Indices=panel_3)
tree_branch_2 = TreeBranch(Tree=robot_feedback_data_4, Path=construct_path_2, MaintainPaths=True)

# Comment: Join all Numbers into one String. This string can then be used to create a ROBOTS-Joint-Target.
jointangles_num = Number(tree_branch_2)
text_join = TextJoin(Text=jointangles_num, Join=",")

jointangle_txt = Text(text_join)

# ----
panel_4 = Panel(jointangle_txt)

display_geo = BooleanToggle(True)
robotsystem_parameter_2 = RobotSystemParameter(load_robot_system)
create_target = CreateTarget(Joints=jointangle_txt, IsCartesian=False)
kinematics = Kinematics(RobotSystem=robotsystem_parameter_2, Target=create_target, DisplayGeometry=display_geo)  # -> Meshes, Joints, Planes, Errors
robotparts_mesh = Mesh(kinematics.Meshes)
plane_3 = Plane(kinematics.Planes)

# ---- group: Display Robot Meshes
robotparts_mesh_2 = Mesh(robotparts_mesh)
list_length = ListLength(List=robotparts_mesh_2)
range = Range(Domain=Domain(0, 1), Steps=list_length)
gradient = Gradient(
    LowerLimit=0,
    UpperLimit=1,
    Parameter=range,
    stops=[0: RGB(243, 57, 0), 0.1: RGB(236, 27, 60), 0.2: RGB(210, 0, 118), 0.3: RGB(103, 0, 120), 0.4: RGB(39, 72, 161), 0.5: RGB(1, 192, 229), 0.6: RGB(18, 178, 90), 0.7: RGB(79, 186, 8), 0.8: RGB(220, 237, 32), 0.9: RGB(247, 159, 20), 1: RGB(243, 57, 0)])
custom_preview = CustomPreview(Geometry=robotparts_mesh_2, Material=gradient)

# ==== cluster DisplayPlaneDirections
origin_display = ClusterInput()  # Display Origin Point
size = ClusterInput()
plane = ClusterInput()
size_2 = Number(size)
origin_display_2 = Boolean(origin_display)
plane_2 = Plane(graft(plane))
deconstruct_plane = DeconstructPlane(Plane=plane_2)  # -> Origin, XAxis, YAxis, ZAxis
division = Division(A=size_2, B=Slider(10, range=0..10))
merge = Merge(Data1=deconstruct_plane.XAxis, Data2=deconstruct_plane.YAxis, Data3=deconstruct_plane.ZAxis)
amplitude = Amplitude(Vector=merge, Amplitude=size_2)
stream_filter = StreamFilter(Gate=origin_display_2, Stream0="1", Stream1=division)
colors = Panel("yellow")
colors_2 = Panel("""red
green
blue""")
symbol_simple = SymbolSimple(Style=Slider(5, range=0..100), Size=stream_filter, Rotation=0, Colour=colors)
vector_display_ex = VectorDisplayEx(Point=deconstruct_plane.Origin, Vector=amplitude, Colour=colors_2, Width=2)
symbol_display = SymbolDisplay(Location=plane_2, Display=symbol_simple)
